% Simulink data dictionary ACC.sldd

AEB_Intervention_Active = Simulink.Signal(DataType="boolean")
Acc_pedal_Pos = Simulink.Signal(DataType="uint8")

Dt_Enum_ACC_Master_Switch_E = enum(DefaultValue="OFF", StorageType="uint8", AddClassNameToEnumNames=true)
  OFF = 0
  ON = 1

ACC_Master_Switch = Simulink.Signal(DataType="Enum: Dt_Enum_ACC_Master_Switch_E")
CAN_Bus_Error = Simulink.Signal(DataType="boolean")
Driver_Door_open = Simulink.Signal(DataType="boolean")
Electronic_Parking_Brake_Failure = Simulink.Signal(DataType="boolean")
Engine_Torque_Unavailable = Simulink.Signal(DataType="boolean")
Fusion_Confidence = Simulink.Signal(DataType="uint8")
Dist_Rel = Simulink.Signal(DataType="uint16")
Ignition_Status = Simulink.Signal(DataType="Enum: Dt_Enum_Ignition_Status_E")
Lane_Width = Simulink.Signal(DataType="uint16", Unit="cm")
Measured_Distance = Simulink.Signal(DataType="uint16")

Dt_Enum_POST_Status_E = enum(DefaultValue="FAILED", StorageType="uint8", AddClassNameToEnumNames=true)
  FAILED = 0
  SUCCESS = 1

POST_Status = Simulink.Signal(DataType="Enum: Dt_Enum_POST_Status_E")

Dt_Enum_Ignition_Status_E = enum(DefaultValue="OFF", StorageType="uint8", AddClassNameToEnumNames=true)
  OFF = 0
  RUN = 1

Pedal_Sensor_Signal_Plausibility_Error = Simulink.Signal(DataType="boolean")
Radar_Signal_Blocked = Simulink.Signal(DataType="boolean")
Target_Detected = Simulink.Signal(DataType="boolean")
Seatbelt_Unlocked = Simulink.Signal(DataType="boolean")
Sensor_Alignment_Lost = Simulink.Signal(DataType="boolean")
Target_Lateral_Offset = Simulink.Signal(DataType="uint16", Unit="cm")
Audible_Warning = Simulink.Signal(DataType="Enum: Dt_Enum_Audible_Warning_E")
Internal_Control_Mode = Simulink.Signal(DataType="Enum: Dt_Enum_Internal_Control_Mode_E")
HMI_ACC_ICON = Simulink.Signal(DataType="Enum: Dt_Enum_HMI_ACC_ICON_E")
Torque_Request_Status = Simulink.Signal(DataType="Enum: Dt_Enum_Torque_Request_Status_E")

Dt_Enum_HMI_ACC_ICON_E = enum(DefaultValue="Off", StorageType="uint8")
  Off = 0
  White = 1
  Green = 2
  Blink_Green = 3
  Red = 4

Dt_Enum_Internal_Control_Mode_E = enum(DefaultValue="Standstill", StorageType="uint8")
  Standstill = 0
  Monitoring = 1
  Speedctrl = 2
  Distctrl = 3
  Passive = 4
  Error = 5

Dt_Enum_Audible_Warning_E = enum(DefaultValue="None", StorageType="uint8")
  None = 0
  Single_Beep = 1
  Chime = 2
  Loud_Chime = 3

Dt_Enum_Torque_Request_Status_E = enum(DefaultValue="Disabled")
  Disabled = 0
  Standby = 1
  Longi = 2
  Dis_active = 3
  Hold_Req = 4
  Override = 5
  Fault = 6

Button_Status = Simulink.Signal(DataType="Enum: Dt_Enum_Button_Status_E")

Dt_Enum_Button_Status_E = enum(DefaultValue="NONE")
  NONE = 0
  SET = 1
  CANCEL = 2
  RESUME = 3

Dt_Enum_Pedal_E = enum(DefaultValue="RELEASED", StorageType="uint8", AddClassNameToEnumNames=true)
  RELEASED = 0
  PRESSED = 1

Brake_Pedal = Simulink.Signal(DataType="Enum: Dt_Enum_Brk_Pedal_E")
V_Lead = Simulink.Signal(DataType="uint8", Unit="km/h")
V_ego = Simulink.Signal(DataType="uint8", Unit="km/h")
HMI_SetSpeed = Simulink.Signal(DataType="uint8", Unit="km/h")
HMI_Distance = Simulink.Signal(DataType="uint16")
Standstill_Dist = Simulink.Signal(DataType="uint16")
Acceleration_request = Simulink.Signal(DataType="single")
Safety_Time_Gap = Simulink.Signal(DataType="uint16", Unit="s")